# Grasshopper definition assembly_example.ghx (Grasshopper 1.0.7)

bang = Button()
panel = Panel("Unload libraries")
unload = PythonScript(bang=bang)
# ---------- unload: Python ----------
from compas_rhino.utilities.misc import get_tolerance
from compas_rhino.utilities.misc import unload_modules

unload_modules("compas")
unload_modules("compas_fab")
unload_modules("ur_online_control")
# ---------- end unload ----------

number_slider = Slider(7, range=1..10)  # disabled
show = BooleanToggle(False)
pt = Point(Point(-0.26, -0.28, 0))  # disabled
block_def = GhPythonScript()  # -> out, block
# ---------- block_def: Python ----------
import os
import sys
import json

from compas.geometry import Frame
from compas.geometry import Vector
from compas.geometry import Box
from compas_fab.robots import Configuration

from ur_online_control.assembly import Element

width = 20.
length = 230.
height = 5.

tolerance_vector = Vector(0, 0, 1.)
savelevel_vector = Vector(0, 0, 50.)

#picking_frame = Frame([-0.43, 0, height], [1, 0, 0], [0, 1, 0])
#picking_configuration = Configuration.from_revolute_values([-6.027, 4.443, -2.313, 5.724, 1.571, -2.885])

# block 
box_frame = Frame([-length/2., -width/2., -height/2.], [1, 0, 0], [0, 1, 0])
box = Box(box_frame, length, width, height)
gripping_frame = Frame([0, 0, height/2], [1, 0, 0], [0, -1, 0])
block = Element.from_shape(box, gripping_frame)
block.id = "short"
# ---------- end block_def ----------
stack = PythonScript(block=block_def.block, num=number_slider, origin=pt)  # -> assembly; inputs num: Int32; disabled
# ---------- stack: Python ----------
import sys
import os
import math

from compas.datastructures import Mesh
from compas.geometry import Transformation, Translation, Box, Frame, Rotation
from compas_ghpython.artists import MeshArtist

from assembly import Assembly
from assembly import Element

#width = brick._source.width
#height = brick._source.height
#length = brick._source.depth

assembly = Assembly()

for i in range(num):
    dx = i * 100.
    new_block = block.copy()
    new_block.transform(Translation([dx, 0, 0]))
    print(new_block.data)
    assembly.add_element(new_block)

T = Translation(list(origin))
assembly.transform(T)
# ---------- end stack ----------
draw = PythonScript(block=block_def.block, show=show)  # -> M, F, S
# ---------- draw: Python ----------
from compas.geometry import Transformation
from compas.geometry import Frame
from compas.datastructures import mesh_transformed
from compas_ghpython.artists import MeshArtist
from compas_ghpython import draw_frame

if show:
    artist = MeshArtist(block.mesh)
    M = artist.draw_mesh()
    F = draw_frame(block.frame)
    S = draw_frame(block._source.frame)
# ---------- end draw ----------
cp = Plane(Plane(origin=(400, 400, 0), x=(0.9981846514, -0.0602279155, 0), y=(0.0602279155, 0.9981846514, 0)))
cp_new = Plane(PlaneXY(800, 0, 0))
generate_assembly = GhPythonScript(centerplane=cp, block=block_def.block, transform=Toggle(False), ptransf=cp_new)  # -> assembly, planes; inputs ptransf: Plane
# ---------- generate_assembly: Python ----------
import Rhino.Geometry as rg
import math
from scriptcontext import sticky as st


from compas.geometry import Frame
from compas.geometry import Transformation
from compas.geometry import Rotation
from compas.geometry import Translation
from compas.geometry import Point

from compas_ghpython.geometry import xtransformed
from compas_ghpython import draw_frame

from ur_online_control.assembly import Assembly
from ur_online_control.assembly import Element

import Rhino.Geometry as rg







assembly = Assembly()
planes = []


#cp.Rotate(math.radians(90), cp.ZAxis, cp.Origin)
#cp.Translate(rg.Vector3d(0,0,1))
cp = centerplane
cf = Frame(cp.Origin, cp.XAxis, cp.YAxis)

for i in range(25):
    
    axis = cf.zaxis
    angle = math.radians(i*3)
    
    R = Rotation.from_axis_and_angle(axis, angle, point=cp.Origin)
    T = Translation([0,0,5*i])
   

    cft = cf.transformed(R * T)

    if i%2 == 0:
        R = Rotation.from_axis_and_angle(cft.zaxis, math.radians(90), point=cft.point)
        cft = cft.transformed(R)
       
    add = math.sin(i/5)*15
    #print(add)
    
    o1 = cft.point + cft.yaxis*(75+add)
    o2 = cft.point - cft.yaxis*(75+add)
    
    f1 = Frame(o1, cft.xaxis, cft.yaxis)
    f2 = Frame(o2, cft.xaxis, cft.yaxis)
    
    planes.append(draw_frame(f1))
    planes.append(draw_frame(f2))
    
    T1 = Transformation.from_frame_to_frame(Frame.worldXY(), f1)
    T2 = Transformation.from_frame_to_frame(Frame.worldXY(), f2)
    
    #print block.to_data()
    new_block_1 = block.transformed(T1)
    new_block_2 = block.transformed(T2)

    assembly.add_element(new_block_1)
    assembly.add_element(new_block_2)


if transform:
    T = Transformation.from_frame_to_frame(cf, Frame(ptransf.Origin, ptransf.XAxis, ptransf.YAxis))
    assembly.transform(T)
# ---------- end generate_assembly ----------
reset = Button()
run = BooleanToggle(False)
list = ValueList({"100", "200", "500"}, selected="100")
list_2 = ValueList({"20", "50", "100", "500"}, selected="500")
python = PythonScript(run=run, reset=reset, count=list, timer_speed=list_2)  # -> C; inputs count: Int32, timer_speed: Int32
# ---------- python: Python ----------
from scriptcontext import sticky as st
import Grasshopper as gh

guid = str(ghenv.Component.InstanceGuid)

counter_key = "counter_" + guid
anchors = "anchors_" + guid
length = count


def ghComponentTimer(run,interval):
    """ Update the component at the interval like using a GH timer """
    
    # Ensure interval is larger than zero
    if interval <= 0:
        interval = 1
        
    # Get the Grasshopper document and component that owns this script
    ghComp = ghenv.Component
    ghDoc = ghComp.OnPingDocument()
    
    # Define the callback function
    def callBack(ghDoc):
        ghComp.ExpireSolution(False)
        
    # Update the solution
    if run:
        ghDoc.ScheduleSolution(interval, gh.Kernel.GH_Document.GH_ScheduleDelegate(callBack))


if reset or counter_key not in st:
    st[counter_key] = 0

else:
    if run:
        if st[counter_key] < length - 1:
            ghComponentTimer(run, timer_speed)
            st[counter_key] += 1
        else:
            st[counter_key] = 0
            ghComponentTimer(run, timer_speed)
            

C = st[counter_key]
# ---------- end python ----------
pln = Plane(generate_assembly.planes)
show_2 = BooleanToggle(True)
show_3 = BooleanToggle(True)
idx = Panel(python)
draw_2 = PythonScript(assembly=generate_assembly.assembly, show_all=show_2, show_counter=show_3, counter=idx)  # -> G, gripping_planes_WCS; inputs counter: Int32
# ---------- draw_2: Python ----------
import os
import sys
from compas_ghpython.artists import MeshArtist

from ur_online_control.assembly import AssemblyArtist
from compas_ghpython import draw_frame

gripping_planes_WCS = []

G = []

if show_all and not show_counter:
    artist = AssemblyArtist(assembly)
    G = artist.draw()

if show_counter:
    for entry in list(assembly.elements())[:counter+1]:
        element = entry[1]
        #print(element)
        artist = MeshArtist(element.mesh)
        mesh = artist.draw_mesh()
        G.append(mesh)
    
    for entry in assembly.elements(data=True):
        print(entry)
        element = entry[1]
        print(element.gripping_frame)
        print element.id
        gripping_planes_WCS.append(draw_frame(entry[1].gripping_frame))
        
    
#print list(assembly.elements())
# ---------- end draw_2 ----------
geo = Geometry(draw_2.G)
pln_2 = Plane(draw_2.gripping_planes_WCS)
preview = CustomPreview(Geometry=geo, Shader=ColourSwatch(SwatchColor=RGBA(255, 186, 186, 146)))
