# Grasshopper definition ur_online_communication.gh (Grasshopper 0.9.76)
# plug-ins: Python Interpreter

# ----
# Check your IP address and set UR IP address
ur_ip = ValueList({"192.168.10.11"}, selected="192.168.10.11")
# 0
server_address = ValueList({"192.168.10.12"}, selected="192.168.10.12")
server_port = Integer(30003)
globals = PythonScript(server_address=server_address, server_port=server_port, ur_ip=ur_ip)  # inputs server_port: Int32
# ---------- globals: Python ----------
from scriptcontext import sticky as st

st["server_address"] = server_address
st["server_port"] = server_port

st["ur_ip"] = ur_ip
# ---------- end globals ----------

# ----
# Check if UR is available
ping = Button()
py = PythonScript(ip=ur_ip, ping=ping)  # -> out
# ---------- py: Python ----------
from scriptcontext import sticky as st
from ur_online_control.communication import is_available


guid = str(ghenv.Component.InstanceGuid)
txt_key = "txt_" + guid
if txt_key not in st:
    st[txt_key] = ""

if ping:
    
    available = is_available(ip)
    
    if available:
        st[txt_key] = "%s is up!" % ip
    else:
        st[txt_key] = "%s is down!" % ip

print st[txt_key]
# ---------- end py ----------
panel = Panel(py)

# ----
# 1
panel_2 = Panel("Start communication server")
# TODO
start = Button()
# * Add auto-update component on receive
# * implement client wrapper completely
server = PythonScript(path="C:\Users\rustr\workspace\ur_online_control", start=start)
# ---------- server: Python ----------
import os
import threading
from scriptcontext import sticky as st

server_address = st["server_address"]
server_port = st["server_port"]
ur_ip = st["ur_ip"]
 
main = os.path.join(path, "communication", "main.py")

if os.path.isfile(main):
        
    def myfunc():
        syscall = "python %s %s %s %s" % (main, server_address, server_port, ur_ip)
        os.system(syscall)
    
    if start:
        t = threading.Thread(target=myfunc)
        t.start()
# ---------- end server ----------

unload = Button()
py_2 = PythonScript(unload=unload)
# ---------- py_2: Python ----------
import sys

def unload_modules(top_level_module_name):
    modules = filter(lambda m: m.startswith(top_level_module_name), sys.modules)
    for module in modules:
        print module
        sys.modules.pop(module)
    return modules

unload_modules("ur_online_control")
# ---------- end py_2 ----------

send = Button()
# 2
panel_3 = Panel("Get UR connected")
ur = PythonScript(send=send)
# ---------- ur: Python ----------
from scriptcontext import sticky as st
from ur_online_control.ur_driver import URDriver

server_address = st["server_address"]
server_port = st["server_port"]
ur_ip = st["ur_ip"]

tool_angle_axis = [0.0, 0.0, 115.6, 0.234, 1.57, 0.0]


ur_driver = URDriver(server_address, server_port, tool_angle_axis, ur_ip, "UR")
print ur_driver

if send:
    ur_driver.send()
# ---------- end ur ----------

connect = Button()
disconnect = Button()
# 3
panel_4 = Panel("Get Grasshopper connected")
client = PythonScript(connect=connect, disconnect=disconnect)  # -> connected, client
# ---------- client: Python ----------
import time
from scriptcontext import sticky as st
from Rhino.RhinoApp import WriteLine
from ur_online_control.grasshopper import GHClient, gh_component_timer
import time

server_address = st["server_address"]
server_port = st["server_port"]

guid = str(ghenv.Component.InstanceGuid)

client_key = "client_" + guid
run_key = "run_" + guid

if connect:
    if client_key not in st:
        st[client_key] = GHClient(server_address, server_port)
        client = st[client_key]
        client.connect_to_server()
        client.start()
        
    else:
        if st[client_key].running:
            WriteLine("Client is already connected.")
        else:
            st[client_key] = GHClient(server_address, server_port)
            client = st[client_key]
            client.connect_to_server()
            client.start()
"""
else:
    if client_key in st:
        # we need a timer to ask if we have something on the rcv queue
        client = st[client_key]
        #if client.running:
        #    #client.run_inner_while()
        #    gh_component_timer(ghenv, True, 1000)
"""

if disconnect:
    if client_key in st:
        client = st[client_key]
        if client.running:
            client.close()

if client_key in st:
    connected =  st[client_key].running
    client = st[client_key]
    print st[client_key].rcv_queue.qsize()
    print st[client_key].snd_queue.qsize()
else:
    connected = False
# ---------- end client ----------
panel_5 = Panel(client.connected)

# ----
# 4
send_2 = Button()
panel_6 = Panel("Send a message")
python = PythonScript(client=client.client, send=send_2)  # -> out
# ---------- python: Python ----------
from ur_online_control.communication.msg_identifiers import *

if send and client:
    client.send(MSG_FLOAT_LIST, [1.2, 3.6, 4, 6, 7])
# ---------- end python ----------
panel_7 = Panel(python)
init = Button()

disconnect_2 = Button()
panel_8 = Panel("initiate connection")
connect_2 = Button()

# ----
# Communication
comm = PythonScript(init=init)  # -> comm
# ---------- comm: Python ----------
from scriptcontext import sticky as st
from mas_lib.robots.communication.ur_communication import URCommunication

ur_ip = st["ur_ip"]
server_ip = st["server_ip"]
server_port = st["server_port"]

if "ur_model" in st:
    ur5 = st["ur_model"]
    if ur5.communication:
        ur5.communication.disconnect()
        comm = URCommunication(ur5, ur_ip, server_ip, server_port, ghenv)
    else:
        comm = URCommunication(ur5, ur_ip, server_ip, server_port, ghenv)
else:
    comm = URCommunication(None, ur_ip, server_ip, server_port, ghenv)
# ---------- end comm ----------
comm_2 = PythonScript(comm=comm)  # -> ur5
# ---------- comm_2: Python ----------
from scriptcontext import sticky as st
from mas_lib.robots.communication.ur_communication import URCommunication

comm.set_robot(ur5)

ur5.set_communication(comm)

st["ur_model"] = ur5
# ---------- end comm_2 ----------

# ----
# UR TCP/IP communication
ur_communication = PythonScript(ur5=comm_2, connect=connect_2, disconnect=disconnect_2)  # -> comm, ur5
# ---------- ur_communication: Python ----------
from scriptcontext import sticky as st
from mas_lib.communication.states import *
from mas_lib.communication.msg_identifiers import *

comm = ur5.communication

# define some storage keys
guid = str(ghenv.Component.InstanceGuid)
comm.current_pose_cartesian_key =  "current_pose_cartesian_" + guid
comm.current_pose_joints_key = "current_pose_joints_" + guid
comm.current_digital_in_key = "current_digital_in_" + guid

if comm.current_pose_cartesian_key not in st:
    st[comm.current_pose_cartesian_key] = None
    st[comm.current_pose_joints_key] = None
    st[comm.current_digital_in_key] = None

    
if not comm.is_connected() and connect:
    comm.connect()

if disconnect:
    comm.disconnect()

connected = comm.is_connected()
# ---------- end ur_communication ----------

# ----
# Calculate shape
calculate = Button()
stop_timer = BooleanToggle(False)
simulation = PythonScript(calculate=calculate, stop_timer=stop_timer)  # -> out, all_xyz, all_force_vectors, all_speeds, tangentsA, tangentsB; inputs msgs: list, num: Int32
# ---------- simulation: Python ----------
from scriptcontext import sticky as st
from Rhino.RhinoApp import WriteLine
import Grasshopper as gh
from server.gh_client import Client
import Rhino.Geometry as rg
import time

def ghComponentTimer(run, interval):
    if interval <= 0: interval = 1
    ghComp = ghenv.Component
    ghDoc = ghComp.OnPingDocument()
    def callBack(ghDoc):
        ghComp.ExpireSolution(False)
    if run:
        ghDoc.ScheduleSolution(interval, gh.Kernel.GH_Document.GH_ScheduleDelegate(callBack))
        
def graft_to_point_list(flattened_points):
    points = []
    for i in range(0, len(flattened_points), 3):
        x, y, z = flattened_points[i:i+3]
        points.append(rg.Point3d(x,y,z))
    return points

def graft_to_vector_list(flattened_vectors):
    vectors = []
    for i in range(0, len(flattened_vectors), 3):
        x, y, z = flattened_vectors[i:i+3]
        vectors.append(rg.Vector3d(x,y,z))
    return vectors

guid = str(ghenv.Component.InstanceGuid)
address = st["simulation_server"]
port = st["simulation_server_port"]

simulation_client_key = "simulation_client_" + guid
timer_key = "timer_" + guid
calculated_key = "calculated_" + guid
num_current_packets_key = "num_current_packets_" + guid

all_xyz_key = "all_xyz_" + guid
all_force_vectors_key =  "all_force_vectors_" + guid
all_speeds_key = "all_speeds_" + guid
calculation_duration_key = "calculation_duration_" + guid
tangentsA_key = "tangentsA_" + guid
tangentsB_key = "tangentsB_" + guid

num_total_packets = num * 5

if calculate:
    st[simulation_client_key] = Client("GH", address, port)
    st[simulation_client_key].connect_to_server()
    if st[simulation_client_key].running:
        for msg_id, msg in msgs:
            st[simulation_client_key].send(int(msg_id), msg)
    st[calculated_key] = False
    st[num_current_packets_key] = 0
    st[all_xyz_key] = []
    st[all_force_vectors_key] = []
    st[all_speeds_key] = []
    st[calculation_duration_key] = time.time()
    st[tangentsA_key] = []
    st[tangentsB_key] = []
else:
    if simulation_client_key not in st or calculated_key not in st:
        pass
    else:
        # we need a timer to ask if we have something on the rcv queue
        client = st[simulation_client_key]
        if client.running:
            if st[num_current_packets_key] == 0 and client.rcvQ.qsize() >= num:
                for i in range(num):
                    array2d_flat = client.rcvQ.get(block = False)
                    array_rg = graft_to_point_list(array2d_flat)
                    st[all_xyz_key].append(array_rg)
                st[num_current_packets_key] += num
            if st[num_current_packets_key] == num and client.rcvQ.qsize() >= num:
                for i in range(num):
                    array2d_flat = client.rcvQ.get(block = False)
                    array_rg = graft_to_vector_list(array2d_flat)
                    st[all_force_vectors_key].append(array_rg)
                st[num_current_packets_key] += num
            if st[num_current_packets_key] == 2 * num and client.rcvQ.qsize() >= num:
                for i in range(num):
                    array = client.rcvQ.get(block = False)
                    st[all_speeds_key].append(array)
                st[num_current_packets_key] += num
            if st[num_current_packets_key] == 3 * num and client.rcvQ.qsize() == 2:
                print "almost done!"
                array = client.rcvQ.get(block = False)
                st[tangentsA_key] = graft_to_vector_list(array)
                array = client.rcvQ.get(block = False)
                st[tangentsB_key] = graft_to_vector_list(array)
               
                WriteLine("Time spent on calculation and sending: %f seconds." % (time.time() - st[calculation_duration_key]))
                WriteLine("Now terminating calculation.")
                client.close()
                st[calculated_key] = True
            if st[num_current_packets_key] != num_total_packets:
                ghComponentTimer(True, 100)
                
            else: # client.rcvQ.qsize() == 0:
                if not st[calculated_key] and stop_timer == False:
                    ghComponentTimer(True, 100)
                    
if simulation_client_key in st:
    print st[simulation_client_key].rcvQ.qsize()

if all_xyz_key in st:
    all_xyz = st[all_xyz_key]
    all_force_vectors = st[all_force_vectors_key]
    all_speeds = st[all_speeds_key]
    tangentsA = st[tangentsA_key]
    tangentsB = st[tangentsB_key]
# ---------- end simulation ----------
entwine = Entwine(
    Branch00=simulation.all_xyz,
    Branch01=simulation.all_force_vectors,
    Branch02=simulation.all_speeds,
    Branch03=simulation.tangentsA,
    Branch04=simulation.tangentsB,
    FlattenInputs=True)
panel_9 = Panel(simulation.out)
