# Grasshopper definition ExampleRobotSimple.gh (Grasshopper 1.0.7)
# plug-ins: UserDataUtils

# ----
# Select Command Number
number_slider = Slider(15, range=0..50)

# ----
# Commands
movej = BooleanToggle(False)
movel = BooleanToggle(True)

# ----
# Start Code
send_all_at_once = BooleanToggle(True)
send = Button()

# ----
# --> Set your IP address
# --> Set robot IP address
ur_ip1 = ValueList({"192.168.10.10", "192.168.10.11", "192.168.10.12", "127.0.0.1"}, selected="192.168.10.10")
# Settings
server_address = ValueList({"192.168.10.1", "192.168.10.2", "192.168.10.3", "192.168.10.20", "127.0.0.1"}, selected="192.168.10.1")
server_port = Integer(30003)
globals = PythonScript(server_address=server_address, server_port=server_port, ur_ip1=ur_ip1)  # inputs server_port: Int32
# ---------- globals: Python ----------
from scriptcontext import sticky as st

st["server_address"] = server_address
st["server_port"] = server_port

st["ur_ip1"] = ur_ip1
print st["ur_ip1"]
# ---------- end globals ----------

pt = Point(<point referenced from the Rhino model>)
crv = Curve(<curve referenced from the Rhino model>)
crv_2 = Curve(<curve referenced from the Rhino model>)
pt_2 = Point(<point referenced from the Rhino model>)
crv_3 = Curve(<curve referenced from the Rhino model>)
crv_4 = Curve(<curve referenced from the Rhino model>)
python = GhPythonScript()  # -> out, joints_rad
# ---------- python: Python ----------
import math

joints = []

joints.append([0, -90, 0, 0, -90, 0])
joints.append([0, -90, 10, 10, -90, 10])

joints_rad = []
for degrees in joints:
    radians = [math.radians(d) for d in degrees]
    joints_rad.append(radians)
    
print joints_rad
# ---------- end python ----------
pl = ConstructPlane(Origin=pt, XAxis=crv, YAxis=crv_2)
pl_2 = ConstructPlane(Origin=pt_2, XAxis=crv_4, YAxis=crv_3)
merge = Merge(Data1=pl, Data2=pl_2)
generate_urscript = PythonScript(
    bool_all=send_all_at_once,
    pos_nb=number_slider,
    joints_list=python.joints_rad,
    planes_cartesian=merge,
    velocity=Slider(20, range=0..1000),
    acceleration=Slider(20, range=0..5000),
    movej=movej,
    movel=movel)  # -> script; inputs pos_nb: Int32, joints_list: list, planes_cartesian: list of Plane
# ---------- generate_urscript: Python ----------
from compas.geometry import Frame

script_lines = []


if movej:
    if bool_all == False:
        configuration = joints_list[pos_nb]
        script_lines.append("movej(%s, a=%f, v=%f, r=%f)" % (str(configuration), acceleration/1000., velocity/1000., 0.0))
    else:
        for configuration in joints_list:
            script_lines.append("movej(%s, a=%f, v=%f, r=%f)" % (str(configuration), acceleration/1000., velocity/1000., 0.0))
if movel:
    if bool_all == False:
        plane = planes_cartesian[pos_nb]
        f = Frame(plane.Origin, plane.XAxis, plane.YAxis)
        ax, ay, az = f.axis_angle_vector
        x, y, z, = plane.Origin[0], plane.Origin[1], plane.Origin[2]
        script_lines.append("movel(p%s, a=%f, v=%f, r=%f)" % (str([x/1000., y/1000., z/1000, ax, ay, az]), acceleration/1000., velocity/1000., 0.005))
    else:
        for plane in planes_cartesian:
            f = Frame(plane.Origin, plane.XAxis, plane.YAxis)
            ax, ay, az = f.axis_angle_vector
            x, y, z, = plane.Origin[0], plane.Origin[1], plane.Origin[2]
            script_lines.append("movel(p%s, a=%f, v=%f, r=%f)" % (str([x/1000., y/1000., z/1000, ax, ay, az]), acceleration/1000., velocity/1000., 0.005))

script = "def prog():\n"
script += "\ttextmsg(\">> program start\")\n"
script += "".join(["\t%s\n" % line for line in script_lines])
script += "\ttextmsg(\"<< program end\")\n"
script += "end\n"
script += "prog()\n\n"


print script

#script = ""
# ---------- end generate_urscript ----------
send_2 = Send(script=generate_urscript, send=send)  # disabled
panel = Panel(generate_urscript)
speckle_he_edvard_bru = Accounts(email="edvard.bruun@gmail.com", restapi="https://hestia.speckle.works/api")
speckle_he_edvard_bru_2 = Accounts(email="edvard.bruun@gmail.com", restapi="https://hestia.speckle.works/api")
streams = Streams(Account=speckle_he_edvard_bru_2, History=False)
projects = Projects(Account=speckle_he_edvard_bru)  # -> Projects, SelectedProject
panel_2 = Panel(streams)
panel_3 = Panel(generate_urscript)
item = ListItem(List=streams, Index=-1, Wrap=True)
streams_2 = Streams(Account=speckle_he_edvard_bru, History=False)
anonymous_stream = DataSender(A=panel_3, DebouncingDisabled=False, manualmode=False, remotecontroller=False)  # -> Log, StreamId
eud = ExpandDictionaryOrSpeckleObject(Dictionaries=item)  # -> StreamId, Name, Description, Layers, Tags, Parent, Children, Ancestors
panel_4 = Panel(eud.StreamId)
add_streams = AddStreamsToProject(Account=speckle_he_edvard_bru, Project=projects.SelectedProject, Streams=anonymous_stream.StreamId)
anonymous_stream_2 = DataReceiver(ID=panel_4, deserialize=True)  # -> F2fa2a4472194ba7B6db883469e4853f, Acb341784da1464580a52de157ebe78f, A17328e12e4043e08a3908722d0f2b59
panel_5 = Panel(anonymous_stream_2.F2fa2a4472194ba7B6db883469e4853f)
send_3 = Button()
send_4 = Send(script=panel_5, send=send_3)

# ==== cluster Send
script = ClusterInput()
send = ClusterInput()
send_2 = PythonScript(script=script, send=send)  # -> out
# ---------- send_2: Python ----------
import socket
from scriptcontext import sticky as st

ur_ip2 = st["ur_ip1"]
ur_port = 30002

if send:
    s = socket.create_connection((ur_ip2, ur_port), timeout=0.5) 
    s.send(script)
    s.close()
# ---------- end send_2 ----------
out = ClusterOutput(send_2)
