# Grasshopper definition speckle_receiver.gh (Grasshopper 1.0.7)
# plug-ins: UserDataUtils

speckle_he_ianting_pr = Accounts(email="ianting@princeton.edu", restapi="https://hestia.speckle.works/api")
projects = Projects(Account=speckle_he_ianting_pr)  # -> Projects, SelectedProject
streams = Streams(Account=speckle_he_ianting_pr, History=False)
panel = Panel(streams)
panel_2 = Panel(projects.Projects)
expand_object = ExpandObject(Object=projects.SelectedProject)  # -> _id, Name, Number, Users, Streams, SubProjects, Owner, Private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
panel_3 = Panel(expand_object.Streams)
list_item = ListItem(List=panel_3, Index=Slider(1, range=0..3), Wrap=True)
ur_simple_speckle = DataReceiver(ID=list_item, deserialize=True)  # -> _52fb8c620ae244018ed3D1aa6c70a444, C191f564Cbd94994874dD3603274102a
